# Grasshopper definition INFO.gh (Grasshopper 1.0.7)
# plug-ins: EleFront, LunchBox

value_list = ValueList({"aux_curves", "cabeca", "Default", "Layer 01", "Layer 02", "Layer 03", "Layer 04", "Layer 05", "pontos", "pontos surface", "texto_pontos"}, selected="pontos surface")
value_list_2 = ValueList({"aux_curves", "cabeca", "Default", "Layer 01", "Layer 02", "Layer 03", "Layer 04", "Layer 05", "pontos", "pontos surface", "texto_pontos"}, selected="texto_pontos")
value_list_3 = ValueList({"Point": 0, "Curve": 1, "Arc": 2, "Circle": 3, "Ellipse": 4, "Line": 5, "Polyline": 6, "Surface": 7, "Brep": 8, "Mesh": 9, "Polysurface": 10, "Block": 11, "Text": 12, "TextDot": 13, "Dimension": 14, "LinearDimension": 15, "AngularDimension": 16, "Hatch": 17, "Leader": 18}, selected="Text")
reference_by_layer = ReferenceByLayer(LayerName=value_list_2)
reference_by_layer_2 = ReferenceByLayer(LayerName=value_list)
filter_by_type = FilterByType(Geometry=reference_by_layer, ObjectType=value_list_3)
area = Area(Geometry=reference_by_layer_2)  # -> Area, Centroid
deconstruct_text = DeconstructText(TextObject=filter_by_type)  # -> Text, Plane, Height, Justification
deconstruct_plane = DeconstructPlane(Plane=deconstruct_text.Plane)  # -> Origin, XAxis, YAxis, ZAxis
panel = Panel(deconstruct_text.Text)
closest_point = ClosestPoint(Point=area.Centroid, Cloud=deconstruct_plane.Origin)  # -> ClosestPoint, CPIndex, Distance
list_item = ListItem(List=deconstruct_text.Text, Index=closest_point.CPIndex, Wrap=True)
replace_text = ReplaceText(Text=list_item, Find="_{", Replace="{", RecursiveReplace=False)
text_split = TextSplit(Text="FULL,PRE,SUB,POS", Separators=",")
panel_2 = Panel("""{
}""")
list_length = ListLength(List=list_item)
panel_3 = Panel(text_split)
value_list_4 = ValueList({"aux_curves", "cabeca", "Default", "Layer 01", "Layer 02", "Layer 03", "Layer 04", "Layer 05", "pontos", "pontos surface", "PONTOS_SENSORES", "texto_pontos"}, selected="PONTOS_SENSORES")
text_split_2 = TextSplit(Text=replace_text, Separators=panel_2)
graft_tree = GraftTree(Tree=list_item, IncludeEmptyLists=True, IncludeNullItems=True)
duplicate_data = DuplicateData(Data=text_split, Number=list_length, Order=True)
panel_4 = Panel(closest_point.CPIndex)
suirify = Suirify(graft_tree)
suirify_2 = Suirify(text_split_2)
merge = Merge(Data1=suirify, Data2=suirify_2)
unflatten_tree = UnflattenTree(Tree=duplicate_data, Guide=merge)
panel_5 = Panel(merge)
panel_6 = Panel(unflatten_tree)
define_object_attributes = DefineObjectAttributes(UserKeys=unflatten_tree, UserValues=merge, Name="PONTOS SENSORES", Layer=value_list_4)
list_item_2 = ListItem(List=merge, Index=0, Wrap=True)  # -> Item, Item1, Item2
unit_x = UnitX(Factor=Slider(0.034, range=0..1))
bake_objects = BakeObjects(Geometry=graft(reference_by_layer_2), Attributes=define_object_attributes, BakeName="PONTOS SENSORES", Bake=False)
panel_7 = Panel(list_item_2.Item)
flip_matrix = FlipMatrix(Data=merge)
negative = Negative(Value=unit_x)
move = Move(Geometry=graft(area.Centroid), Motion=negative)  # -> Geometry, Transform
create_csv = CreateCSV(DataGridHeaders=text_split, ValueTree=flip_matrix, Delimiter=",")
panel_8 = Panel(flip_matrix)
panel_9 = Panel(create_csv)
panel_10 = Panel("""b
c
d""")
text_tag_3d = TextTag3D(Location=move.Geometry, Text=list_item_2.Item, Size=Slider(0.1, range=0..1), Justification=5)
